% Simulink data dictionary Navigation.sldd

starTracker_meas = Simulink.Bus()  % star tracker measurements bus
  timestamp: double, Unit="sec"  % measure timestamp
  quaternion: double[4 1]  % measured quaternion

IMU_meas = Simulink.Bus()  % IMU measurements
  acc_timestamp: double, Unit="sec"  % timestamp of acceleration measurement
  gyro_timestamp: double, Unit="sec"  % timestamp of gyroscope measurement
  acc: double[3 1], Unit="m/s^2"  % measured acceleration
  gyro: double[3 1], Unit="rad/s"  % measured angular rates

radio_meas = Simulink.Bus()
  range_PN: double, Unit="m"  % Range measurements using the pseudo-noise signal
  range_CP: double, Unit="m"  % Range measurements using the carrier phase measurement
  range_rate: double, Unit="m/s"  % Range rate measurements
  range_timestamp: double, Unit="s"  % Range timestamp
  range_rate_timestamp: double, Unit="s"  % Range rate timestamp

Measurements = Simulink.Bus()  % Bus containing all the measurements
  radio: Bus: radio_meas
  IMU: Bus: IMU_meas
  starTracker: Bus: starTracker_meas

Propagation = struct(
  lf=struct(value=5, unit="Hz", description="State propagation frequency"),
  hf=struct(value=30, unit="Hz", description="Higher propagation frequency for IMU error comoensation algorithms"))