% Simulink data dictionary Scenario.sldd

time = struct(value=604800, unit="sec", description="Integration time")

Environment = struct(
  Sun=struct(mu=struct(value=132712440018, unit="km^3/s^2")),
  Mercury=struct(mu=struct(value=22032, unit="km^3/s^2")),
  Venus=struct(mu=struct(value=324859, unit="km^3/s^2")),
  Earth=struct(mu=struct(value=398600, unit="km^3/s^2")),
  Moon=struct(
    mu=struct(value=4905, unit="km^3/s^2"),
    radius=struct(value=1738, unit="km"),
    orientation=struct(
      type="ZXZ",
      value=[1.193109 0.3819133 -3.133156
       1.192949 0.3819134 -3.133156
       1.192789 0.3819135 -3.133156
       1.192629 0.3819136 -3.133155
       1.19247 0.3819136 -3.133155
       1.19231 0.3819137 -3.133155
       1.19215 0.3819138 -3.133155
       1.19199 0.3819139 -3.133155
       1.19183 0.381914 -3.133155
       1.191671 0.3819141 -3.133155
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       ],
      unit="rad",
      description="ZXZ rotation angles from J2000 to MOON_PA"),
    jd_interval=struct(
      value=[2460594 2460594 2460594 2460594 2460594 2460594 2460594 2460594 2460594 2460594.00625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 2460601],
      unit="julian date",
      description="Interpolation points for Environment.Moon.eul"),
    orientation_dot=struct(
      unit="rad/s",
      description="Time derivative of the ZXZ rotation angles from J2000 to MOON_PA",
      value=[-2.663365e-06 1.393746e-09 1.778105e-09
       -2.663364e-06 1.39394e-09 1.777435e-09
       -2.663364e-06 1.394134e-09 1.776764e-09
       -2.663363e-06 1.394328e-09 1.776094e-09
       -2.663362e-06 1.394522e-09 1.775423e-09
       -2.663362e-06 1.394716e-09 1.774752e-09
       -2.663361e-06 1.394909e-09 1.774081e-09
       -2.66336e-06 1.395103e-09 1.77341e-09
       -2.66336e-06 1.395297e-09 1.772739e-09
       -2.663359e-06 1.395491e-09 1.772068e-09
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       ])),
  Mars=struct(mu=struct(value=42828, unit="km^3/s^2")),
  Jupiter=struct(mu=struct(value=126686534, unit="km^3/s^2")),
  Saturn=struct(mu=struct(value=37931187, unit="km^3/s^2")),
  Neptune=struct(mu=struct(value=6836529, unit="km^3/s^2")),
  Pluto=struct(mu=struct(value=871, unit="km^3/s^2")),
  Uranus=struct(mu=struct(value=5793939, unit="km^3/s^2")),
  Date=struct(year=2024, month=10, day=10, hour=12, min=0, sec=0))